# Grasshopper definition Base from Loft.gh (Grasshopper 1.0.7)
# plug-ins: Pufferfish, treesloth01

# ----
# Get the bottom curve from a surface
geometry_pipeline = GeometryPipeline(
    GroupByLayer=False,
    GroupByType=False,
    IncludeHidden=True,
    IncludeLocked=True,
    LayerFilter="GH_Loft",
    NameFilter="*",
    SublayerFiltering=True,
    TypeFilter=1073741848)
brep_edges = BrepEdges(Brep=geometry_pipeline)  # -> Naked, Interior, NonManifold
curve = Curve(brep_edges.Naked)
point_on_curve = PointOnCurve(curve, parameter=0.5)
evaluate_curve = EvaluateCurve(Curve=reparameterize(curve), Parameter=point_on_curve)  # -> Point, Tangent, Angle
deconstruct = Deconstruct(Point=evaluate_curve.Point)  # -> XComponent, YComponent, ZComponent
sort_list = SortList(Keys=deconstruct.ZComponent, ValuesValuesA=curve)  # -> Keys, ValuesValuesA
list_item = ListItem(List=sort_list.ValuesValuesA, Index="0", Wrap=True)

# ----
# Get the bottom curve from a surface
geometry_pipeline_2 = GeometryPipeline(
    GroupByLayer=False,
    GroupByType=False,
    IncludeHidden=True,
    IncludeLocked=True,
    LayerFilter="GH_Loft",
    NameFilter="*",
    SublayerFiltering=True,
    TypeFilter=1073741848)
brep_edges_2 = BrepEdges(Brep=geometry_pipeline_2)  # -> Naked, Interior, NonManifold
curve_2 = Curve(brep_edges_2.Naked)
point_on_curve_2 = PointOnCurve(curve_2, parameter=0.5)
evaluate_curve_2 = EvaluateCurve(Curve=reparameterize(curve_2), Parameter=point_on_curve_2)  # -> Point, Tangent, Angle
deconstruct_2 = Deconstruct(Point=evaluate_curve_2.Point)  # -> XComponent, YComponent, ZComponent
sort_list_2 = SortList(Keys=deconstruct_2.ZComponent, ValuesValuesA=curve_2)  # -> Keys, ValuesValuesA
list_item_2 = ListItem(List=sort_list_2.ValuesValuesA, Index="0", Wrap=True)

# ----
# Offset the curve by nozel diameter
area = Area(Geometry=list_item_2)  # -> Area, Centroid
# Nozel Diameter
# Stepover %
number_slider = Slider(3, range=0..10)
curve_closest_point = CurveClosestPoint(Point=area.Centroid, Curve=list_item_2)  # -> Point, Parameter, Distance
multiplication = Multiplication(A=number_slider, B=Slider(1, range=0.1..2))
division = Division(A=curve_closest_point.Distance, B=multiplication)
series = Series(Start=0, Step=multiplication, Count=division)
negative = Negative(Value=series)
offset_curve = OffsetCurve(Curve=list_item_2, Distance=negative, Corners=1)

# ----
# Offset the curve by nozel diameter
area_2 = Area(Geometry=list_item)  # -> Area, Centroid
number_slider_2 = Slider(3, range=0..10)
curve_closest_point_2 = CurveClosestPoint(Point=area_2.Centroid, Curve=list_item)  # -> Point, Parameter, Distance
multiplication_2 = Multiplication(A=number_slider_2, B=Slider(1, range=0.1..2))
division_2 = Division(A=curve_closest_point_2.Distance, B=multiplication_2)
series_2 = Series(Start=0, Step=multiplication_2, Count=division_2)
negative_2 = Negative(Value=series_2)
offset_curve_2 = OffsetCurve(Curve=list_item, Distance=negative_2, Corners=1)

length = Length(Curve=offset_curve_2)
# Split walls from Fill
# and overlap start of spiral
sort_list_3 = SortList(Keys=length, ValuesValuesA=offset_curve_2)  # -> Keys, ValuesValuesA
number_slider_3 = Slider(3, range=0..10)
flatten_tree = FlattenTree(Tree=sort_list_3.ValuesValuesA, Path="{0}")
x_minus_one = XMinusOne(NumberX=number_slider_3)
split_list = SplitList(List=flatten(flatten_tree), Index=number_slider_3)  # -> ListA, ListB
panel = Panel(split_list.ListA)
first_last = FirstLast(List=split_list.ListA)  # -> FirstValue, LastValue
curve_3 = Curve(split_list.ListA)

unit_x = UnitX(Factor=1)
contour = Contour(Shape=first_last.LastValue, Point=Point(0, 0, 0), Direction=unit_x, Distance=number_slider_2)
flatten_tree_2 = FlattenTree(Tree=contour, Path="{0}")
# Join contour into one zigzag
dispatch = Dispatch(List=flatten_tree_2, DispatchPattern=[True, False])  # -> ListA, ListB
flip_curve = FlipCurve(Curve=dispatch.ListB)  # -> Curve, Flag
weave = Weave(Pattern=[0, 1], Stream0=dispatch.ListA, Stream1=flip_curve.Curve, NullGaps=False)
discontinuity = Discontinuity(Curve=weave, Level=1)  # -> Points, Parameters
polyline = PolyLine(Vertices=flatten(discontinuity.Points), Closed=False)
curve_4 = Curve(curve_3)

merge = Merge(Data1=curve_4, Data2=polyline)

length_2 = Length(Curve=offset_curve)
# Split walls from Fill
# and overlap start of spiral
sort_list_4 = SortList(Keys=length_2, ValuesValuesA=offset_curve)  # -> Keys, ValuesValuesA
number_slider_4 = Slider(2, range=0..10)
flatten_tree_3 = FlattenTree(Tree=sort_list_4.ValuesValuesA, Path="{0}")
split_list_2 = SplitList(List=flatten(flatten_tree_3), Index=number_slider_4)  # -> ListA, ListB
panel_2 = Panel(split_list_2.ListA)

x_minus_one_2 = XMinusOne(NumberX=number_slider_4)
split_list_3 = SplitList(List=flatten(flatten_tree_3), Index=x_minus_one_2)  # -> ListA, ListB

panel_3 = Panel(split_list_3.ListB)

number_slider_5 = Slider(101, range=0..1000)
divide_curve = DivideCurve(Curve=split_list_3.ListB, Count=number_slider_5, Kinks=False)  # -> Points, Tangents, Parameters
flip_matrix = FlipMatrix(Data=divide_curve.Points)
polyline_2 = PolyLine(Vertices=flip_matrix, Closed=False)
# Join offset fill into one spiral
explode = Explode(Curve=polyline_2, Recursive=True)  # -> Segments, Vertices
end_points = EndPoints(Curve=explode.Segments)  # -> Start, End
vector_2pt = Vector2Pt(PointA=end_points.Start, PointB=end_points.End, Unitize=False)  # -> Vector, Length
flip_matrix_2 = FlipMatrix(Data=vector_2pt.Vector)
range = Range(Domain=Domain(0, 1), Steps=expr("x-1", number_slider_5))
multiplication_3 = Multiplication(A=flip_matrix_2, B=range)
move = Move(Geometry=divide_curve.Points, Motion=multiplication_3)  # -> Geometry, Transform
flatten_tree_4 = FlattenTree(Tree=move.Geometry, Path="{0}")
polyline_3 = PolyLine(Vertices=flatten_tree_4, Closed=False)

curve_5 = Curve(split_list_2.ListA)
merge_2 = Merge(Data1=polyline_3, Data2=curve_5)
