# Grasshopper definition Grashopper Fillet All Tool.gh (Grasshopper 1.0.7)
# plug-ins: Bifocals

brep = Brep(<brep referenced from the Rhino model>)
convex_edges = ConvexEdges(Brep=brep)  # -> Convex, Concave, Mixed
fillet_edge = FilletEdge(Shape=brep, Blend=0, Metric=0, Edges=convex_edges.Convex, Radii=Slider(2, range=1..10))
convex_edges_2 = ConvexEdges(Brep=fillet_edge)  # -> Convex, Concave, Mixed
fillet_edge_2 = FilletEdge(Shape=fillet_edge, Blend=0, Metric=0, Edges=convex_edges_2.Concave, Radii=Slider(1.828, range=0..10))
