# Grasshopper definition Grasshopper GCode Version 1.gh (Grasshopper 1.0.7)
# plug-ins: Bifocals, Anemone

brep = Brep(<brep referenced from the Rhino model>)
surface = Surface(<surface referenced from the Rhino model>)
curve = Curve([<curve referenced from the Rhino model> x2])
brep_2 = Brep(<brep referenced from the Rhino model>)
loft = Loft(Curves=curve, Options={Adjust=False, Closed=False, LoftEnds=0, LoftSimp=0, LoftType=0, Rebuild=10, Refit=0.01})
geometry = Geometry(brep)
brep_3 = Brep(<brep referenced from the Rhino model>)
polygon = Polygon(Plane=PlaneXY(0, 0, 0), Radius=Slider(30, range=0..100), Segments=Slider(3, range=0..10), FilletRadius=0)  # -> Polygon, Length
geometry_2 = Geometry(loft)
brep_4 = Brep(<brep referenced from the Rhino model>)
contour = Contour(Shape=surface, Point=Point(0, 0, 0), Direction=Vector(0, 0, 1), Distance="1")
deconstruct_brep = DeconstructBrep(Brep=geometry)  # -> Faces, Edges, Vertices

# ---- group: solid - mesh - vase gcode
brep_5 = Brep(<brep referenced from the Rhino model>)
mesh = Mesh(brep_5)
contour_2 = Contour(Shape=brep_3, Point=Point(0, 0, 0), Direction=Vector(0, 0, 1), Distance=Slider(1.5, range=1..3))
number_slider = Slider(200, range=10..200)
divide_curve = DivideCurve(Curve=contour_2, Count=number_slider, Kinks=False)  # -> Points, Tangents, Parameters
flip_matrix = FlipMatrix(Data=divide_curve.Points)
polyline = PolyLine(Vertices=flip_matrix, Closed=False)
explode = Explode(Curve=polyline, Recursive=True)  # -> Segments, Vertices
end_points = EndPoints(Curve=explode.Segments)  # -> Start, End
vector_2pt = Vector2Pt(PointA=end_points.Start, PointB=end_points.End, Unitize=False)  # -> Vector, Length
range = Range(Domain=Domain(0, 1), Steps=number_slider)
flip_matrix_2 = FlipMatrix(Data=vector_2pt.Vector)
multiplication = Multiplication(A=flip_matrix_2, B=range)
move = Move(Geometry=divide_curve.Points, Motion=multiplication)  # -> Geometry, Transform
polyline_2 = PolyLine(Vertices=flatten(move.Geometry), Closed=False)
vector_length = VectorLength(Vector=flip_matrix_2)
panel = Panel(vector_length)
explode_2 = Explode(Curve=polyline_2, Recursive=True)  # -> Segments, Vertices
control_points = ControlPoints(Curve=polyline_2)  # -> Points, Weights, Knots
flatten_tree = FlattenTree(Tree=vector_length, Path="{0}")
polyline_3 = PolyLine(Vertices=flatten(control_points.Points), Closed=False)
length = Length(Curve=explode_2.Segments)
bounds = Bounds(Numbers=flatten_tree)
panel_2 = Panel(control_points.Points)
division = Division(A=length, B=Slider(2, range=1..5))
remap_numbers = RemapNumbers(Value=flatten_tree, Source=bounds, Target="0.5 to 1")  # -> Mapped, Clipped
multiplication_2 = Multiplication(A=division, B=remap_numbers.Mapped)
panel_3 = Panel(remap_numbers.Mapped)
deconstruct = Deconstruct(Point=flatten(panel_2))  # -> XComponent, YComponent, ZComponent
insert_items = InsertItems(List=multiplication_2, Item="0", Indices="0", Wrap=True)
multiplication_3 = Multiplication(A=Slider(16, range=0..100), B="60")
concatenate = Concatenate(
    F="G1",
    G=" F",
    E=multiplication_3,
    Fragment_A=" X",
    Fragment_B=deconstruct.XComponent,
    A=" Y",
    B=deconstruct.YComponent,
    C=" Z",
    D=deconstruct.ZComponent,
    H=" E",
    I=insert_items)
panel_4 = Panel("""; Start G-code for WASP 40100 Clay Printer with CFS
G21                  ; Set units to millimeters
G90                  ; Use absolute positioning for X, Y, and Z
M83                  ; Set extruder to relative mode
G92 X0 Y0 Z0 E0      ; Reset all axes positions to zero

; Homing axes
G28 X Y Z            ; Home all axes (only if your setup requires it)
G1 Z50 F5000; Raise Z to avoid scraping the print bed

; Prime extruder (initial small extrusion to get material flowing)
G1 E5 F600          ; Extrude 10 mm to prime at faster rate

; Move to starting position for priming arc along boundary of cylindrical build volume
;G1 X190 Y0 Z0.5 F9000 ; Move to radius boundary on positive X axis at safe height

; Priming arc along 380 mm diameter boundary with point-to-point coordinates
;G1 X164.5 Y95 F540 E20 ; Move along arc, extrude 20 mm
;G1 X95 Y164.5 F540 E20 ; Next point on arc, extrude 20 mm
;G1 X0 Y190 F540 E20     ; Next point on arc, extrude 20 mm

; Prepare to start print
G1 E-5 F600          ; Retract slightly to relieve pressure
G1 Z1.5 F2500        ; Lower Z to start printing layer height""")
panel_5 = Panel(""";End GCode
M104 S0  ;extruder heater off
M140 S0  ;heated bed heater off (if you have it)
G91  ;relative positioning
G1 E-1 F300   ;retract the filament a bit
G1 Z+1 E-5 F9000 ;move Z up a bit and retract filament even more
M107  ;fan off
G28 X0 Y0  ;move X/Y to min endstops, so the head is out of the way
;M84                         ;steppers off
G90                         ;absolute positioning""")
merge = Merge(Data1=flatten(panel_4), Data2=flatten(concatenate), Data3=flatten(panel_5))
panel_6 = Panel(merge)

# ---- group: Base Layer Height
number_slider_2 = Slider(2, range=0.1..4)

# ----
mesh_2 = Mesh(<mesh referenced from the Rhino model>)
surface_2 = Surface(deconstruct_brep.Faces)
dispatch = Dispatch(List=flatten(contour), DispatchPattern=[True, False])  # -> ListA, ListB

# ---- group: Non-Planer / Base Layer Height
number_slider_3 = Slider(2, range=0.1..4)

# ----
bounding_box = BoundingBox(Content=geometry, Plane=PlaneXY(0, 0, 0))  # -> Box, Box_2
fast_loop_start = FastLoopStart(Iterations=Slider(2, range=0..10), Data=polygon.Polygon)  # -> port, Counter, Data
bounding_box_2 = BoundingBox(Content=geometry_2, Plane=PlaneXY(0, 0, 0))  # -> Box, Box_2
deconstruct_box = DeconstructBox(Box=bounding_box.Box)  # -> Plane, X, Y, Z
explode_3 = Explode(Curve=fast_loop_start.Data, Recursive=True)  # -> Segments, Vertices
divide_curve_2 = DivideCurve(Curve=dispatch.ListB, Count="100", Kinks=False)  # -> Points, Tangents, Parameters
deconstruct_box_2 = DeconstructBox(Box=bounding_box_2.Box)  # -> Plane, X, Y, Z
list_item = ListItem(List=surface_2, Index=0, Wrap=True)
curve_2 = Curve(explode_3.Segments)
deconstruct_domain = DeconstructDomain(Domain=deconstruct_box.Z)  # -> Start, End
divide_curve_3 = DivideCurve(Curve=dispatch.ListA, Count="100", Kinks=False)  # -> Points, Tangents, Parameters
deconstruct_domain_2 = DeconstructDomain(Domain=deconstruct_box_2.Z)  # -> Start, End
divide_curve_4 = DivideCurve(Curve=curve_2, Count=Slider(3, range=0..10), Kinks=False)  # -> Points, Tangents, Parameters
dispatch_2 = Dispatch(List=divide_curve_2.Points, DispatchPattern=[True, False])  # -> ListA, ListB
division_2 = Division(A=deconstruct_domain.End, B=number_slider_2)
division_3 = Division(A=deconstruct_domain_2.End, B=Slider(1.46, range=0.1..3))
brep_closest_point = BrepClosestPoint(Point=dispatch_2.ListB, Brep=surface)  # -> Point, Normal, Distance
list_item_2 = ListItem(List=divide_curve_4.Points, Index=0, Wrap=True)  # -> Item, Item1, Item2, Item3
round = Round(Number=division_2)  # -> Nearest, Floor, Ceiling
amplitude = Amplitude(Vector=brep_closest_point.Normal, Amplitude="3")
range_2 = Range(Domain=Domain(0, 1), Steps=division_3)
move_2 = Move(Geometry=dispatch_2.ListB, Motion=amplitude)  # -> Geometry, Transform
polyline_4 = PolyLine(Vertices=divide_curve_3.Points, Closed=False)
range_3 = Range(Domain=Domain(0, 1), Steps=round.Nearest)
panel_7 = Panel(round.Nearest)
weave = Weave(Pattern=[0, 1], Stream0=dispatch_2.ListA, Stream1=move_2.Geometry, NullGaps=False)
brep_join = BrepJoin(Breps=list_item)  # -> Breps, Closed
construct_point = ConstructPoint(XCoordinate=range_3, YCoordinate=0, ZCoordinate=0)
line = Line(StartPoint=list_item_2.Item, EndPoint=list_item_2.Item1)
line_2 = Line(StartPoint=list_item_2.Item1, EndPoint=list_item_2.Item2)
line_3 = Line(StartPoint=list_item_2.Item2, EndPoint=list_item_2.Item3)
polyline_5 = PolyLine(Vertices=weave, Closed=False)
construct_point_2 = ConstructPoint(XCoordinate=range_2, YCoordinate=0, ZCoordinate=0)
divide_surface = DivideSurface(Surface=geometry, UCount=construct_point, VCount=construct_point)  # -> flatten(Points), Normals, Parameters
list_item_3 = ListItem(List=curve_2, Index=0, Wrap=True)
weave_2 = Weave(Pattern=[0, 1], Stream0=polyline_4, Stream1=polyline_5, NullGaps=False)
iso_curve = IsoCurve(Surface=reparameterize(geometry), UVPoint=construct_point)  # -> UIsocurve, VIsocurve

# ---- group: Base resolution
number_slider_4 = Slider(150, range=0..200)

# ----
image_sampler = ImageSampler(
    divide_surface.Points,
    FilePath="C:\Users\CarlMcAteer\Desktop\Test Ghopper Grad.png",
    Filter="Colour",
    Interpolate=False,
    Umax=1,
    Umin=0,
    Vmax=1,
    Vmin=0,
    Wrap=1)
iso_curve_2 = IsoCurve(Surface=reparameterize(geometry_2), UVPoint=construct_point_2)  # -> UIsocurve, VIsocurve
number = Number(list_item_3)
end_points_2 = EndPoints(Curve=weave_2)  # -> Start, End
tangent = Tangent(Value=degrees(Slider(60, range=0..100)))
division_4 = Division(A=number, B=Slider(6, range=0..10))
perp_frame = PerpFrame(Curve=line_2, Parameter=Slider(0.5, range=0..1))
curve_3 = Curve(iso_curve.VIsocurve)
curve_4 = Curve(iso_curve.UIsocurve)

# ---- group: Non-Planer / Base resolution
number_slider_5 = Slider(150, range=0..200)

# ----
cull_index = CullIndex(List=end_points_2.Start, Indices=Slider(0, range=0..5), Wrap=True)
polyline_6 = PolyLine(Vertices=image_sampler, Closed=False)
curve_5 = Curve(iso_curve_2.UIsocurve)
multiplication_4 = Multiplication(A=division_4, B=tangent)
deconstruct_plane = DeconstructPlane(Plane=perp_frame)  # -> Origin, XAxis, YAxis, ZAxis
graft_tree = GraftTree(Tree=cull_index, IncludeEmptyLists=True, IncludeNullItems=True)
divide_curve_5 = DivideCurve(Curve=iso_curve.VIsocurve, Count=number_slider_4, Kinks=False)  # -> Points, Tangents, Parameters
divide_curve_6 = DivideCurve(Curve=iso_curve_2.VIsocurve, Count=Slider(50, range=0..100), Kinks=False)  # -> Points, Tangents, Parameters
multiplication_5 = Multiplication(A=deconstruct_plane.YAxis, B=multiplication_4)
line_4 = Line(StartPoint=end_points_2.End, EndPoint=graft_tree)
polyline_7 = PolyLine(Vertices=divide_curve_5.Points, Closed=False)
merge_2 = Merge(Data1=weave_2, Data2=line_4)
polyline_8 = PolyLine(Vertices=divide_curve_6.Points, Closed=False)
control_points_2 = ControlPoints(Curve=polyline_7)  # -> Points, Weights, Knots
join_curves = JoinCurves(Curves=merge_2, Preserve=False)
explode_4 = Explode(Curve=join_curves, Recursive=True)  # -> Segments, Vertices
end_points_3 = EndPoints(Curve=explode_4.Segments)  # -> Start, End
vector_2pt_2 = Vector2Pt(PointA=end_points_3.Start, PointB=end_points_3.End, Unitize=False)  # -> Vector, Length
control_points_3 = ControlPoints(Curve=polyline_8)  # -> Points, Weights, Knots
tangent_2 = Tangent(Value=degrees(Slider(60, range=0..100)))
move_3 = Move(Geometry=deconstruct_plane.Origin, Motion=multiplication_5)  # -> Geometry, Transform
curve_to_polyline = CurveToPolyline(Curve=join_curves, ToleranceDistance=0, ToleranceAngle=0)  # -> Polyline, Segments
cull_index_2 = CullIndex(List=control_points_2.Points, Indices="0", Wrap=True)
cull_index_3 = CullIndex(List=control_points_3.Points, Indices="0", Wrap=True)
multiplication_6 = Multiplication(A=division_4, B=tangent_2)
polyline_9 = PolyLine(Vertices=flatten(vector_2pt_2.Vector), Closed=False)
list_length = ListLength(List=cull_index_2)
flip_matrix_3 = FlipMatrix(Data=cull_index_2)
line_5 = Line(StartPoint=move_3.Geometry, EndPoint=list_item_2.Item1)
line_6 = Line(StartPoint=move_3.Geometry, EndPoint=list_item_2.Item2)
list_length_2 = ListLength(List=cull_index_3)
flip_matrix_4 = FlipMatrix(Data=cull_index_3)
polyline_10 = PolyLine(Vertices=flip_matrix_3, Closed=False)
polyline_11 = PolyLine(Vertices=flip_matrix_4, Closed=False)
explode_5 = Explode(Curve=polyline_10, Recursive=True)  # -> Segments, Vertices
merge_3 = Merge(Data1=line_5, Data2=line, Data3=line_3, Data4=line_6)
explode_6 = Explode(Curve=polyline_11, Recursive=True)  # -> Segments, Vertices
flatten_tree_2 = FlattenTree(Tree=merge_3, Path="{0}")
end_points_4 = EndPoints(Curve=explode_5.Segments)  # -> Start, End
end_points_5 = EndPoints(Curve=explode_6.Segments)  # -> Start, End
join_curves_2 = JoinCurves(Curves=flatten_tree_2, Preserve=False)
vector_length_2 = VectorLength(Vector=vector_2pt_2.Vector)
panel_8 = Panel(vector_length_2)
vector_2pt_3 = Vector2Pt(PointA=end_points_4.Start, PointB=end_points_4.End, Unitize=False)  # -> Vector, Length
explode_7 = Explode(Curve=polyline_9, Recursive=True)  # -> Segments, Vertices
vector_2pt_4 = Vector2Pt(PointA=end_points_5.Start, PointB=end_points_5.End, Unitize=False)  # -> Vector, Length
range_4 = Range(Domain=Domain(0, 1), Steps=expr("x-1", list_length))
control_points_4 = ControlPoints(Curve=curve_to_polyline.Polyline)  # -> Points, Weights, Knots
flatten_tree_3 = FlattenTree(Tree=vector_length_2, Path="{0}")
flip_matrix_5 = FlipMatrix(Data=vector_2pt_3.Vector)
range_5 = Range(Domain=Domain(0, 1), Steps=expr("x-1", list_length_2))
polyline_12 = PolyLine(Vertices=flatten(control_points_4.Points), Closed=False)
flip_matrix_6 = FlipMatrix(Data=vector_2pt_4.Vector)
length_2 = Length(Curve=explode_7.Segments)
multiplication_7 = Multiplication(A=flip_matrix_5, B=range_4)
bounds_2 = Bounds(Numbers=flatten_tree_3)
panel_9 = Panel(control_points_4.Points)
fast_loop_end = FastLoopEnd(port=fast_loop_start.port, Exit=False, Data=join_curves_2, RecordData=False, TimeOutVal=0)
multiplication_8 = Multiplication(A=flip_matrix_6, B=range_5)
division_5 = Division(A=length_2, B=Slider(2, range=1..5))
remap_numbers_2 = RemapNumbers(Value=flatten_tree_3, Source=bounds_2, Target="0.5 to 1")  # -> Mapped, Clipped
curve_6 = Curve(fast_loop_end)
move_4 = Move(Geometry=cull_index_2, Motion=multiplication_7)  # -> Geometry, Transform
move_5 = Move(Geometry=cull_index_3, Motion=multiplication_8)  # -> Geometry, Transform

# ---- group: Extrusion Multiple
number_slider_6 = Slider(3, range=1..5)

# ----
multiplication_9 = Multiplication(A=division_5, B=remap_numbers_2.Mapped)
polyline_13 = PolyLine(Vertices=flatten(move_4.Geometry), Closed=False)
panel_10 = Panel(remap_numbers_2.Mapped)
polyline_14 = PolyLine(Vertices=flatten(move_5.Geometry), Closed=False)
unit_z = UnitZ(Factor=Slider(100, range=0..100))
unit_z_2 = UnitZ(Factor=Slider(50, range=0..100))
deconstruct_2 = Deconstruct(Point=flatten(panel_9))  # -> XComponent, YComponent, ZComponent
number_slider_7 = Slider(1.4, range=0.1..3)
insert_items_2 = InsertItems(List=multiplication_9, Item="0", Indices="0", Wrap=True)
multiplication_10 = Multiplication(A=Slider(16, range=0..100), B="60")
move_6 = Move(Geometry=curve_6, Motion=unit_z)  # -> Geometry, Transform
move_7 = Move(Geometry=curve_6, Motion=unit_z_2)  # -> Geometry, Transform

# ---- group: Non-Planer / Extrusion Multiple
number_slider_8 = Slider(2, range=1..5)

# ----
concatenate_2 = Concatenate(
    F="G1",
    G=" F",
    E=multiplication_10,
    Fragment_A=" X",
    Fragment_B=deconstruct_2.XComponent,
    A=" Y",
    B=deconstruct_2.YComponent,
    C=" Z",
    D=deconstruct_2.ZComponent,
    H=" E",
    I=insert_items_2)
scale_nu = ScaleNU(Geometry=move_7.Geometry, Plane=PlaneXY(0, 0, 0), ScaleX=number_slider_7, ScaleY=number_slider_7, ScaleZ=1)  # -> Geometry, Transform
vector_length_3 = VectorLength(Vector=flip_matrix_5)
panel_11 = Panel(vector_length_3)
vector_length_4 = VectorLength(Vector=flip_matrix_6)
panel_12 = Panel(vector_length_4)
panel_13 = Panel(""";End GCode
M104 S0  ;extruder heater off
M140 S0  ;heated bed heater off (if you have it)
G91  ;relative positioning
G1 E-1 F300   ;retract the filament a bit
G1 Z+1 E-5 F9000 ;move Z up a bit and retract filament even more
M107  ;fan off
G28 X0 Y0  ;move X/Y to min endstops, so the head is out of the way
;M84                         ;steppers off
G90                         ;absolute positioning""")
panel_14 = Panel("""; Start G-code for WASP 40100 Clay Printer with CFS
G21                  ; Set units to millimeters
G90                  ; Use absolute positioning for X, Y, and Z
M83                  ; Set extruder to relative mode
G92 X0 Y0 Z0 E0      ; Reset all axes positions to zero

; Homing axes
G28 X Y Z            ; Home all axes (only if your setup requires it)
G1 Z50 F5000; Raise Z to avoid scraping the print bed

; Prime extruder (initial small extrusion to get material flowing)
G1 E5 F600          ; Extrude 10 mm to prime at faster rate

; Move to starting position for priming arc along boundary of cylindrical build volume
;G1 X190 Y0 Z0.5 F9000 ; Move to radius boundary on positive X axis at safe height

; Priming arc along 380 mm diameter boundary with point-to-point coordinates
;G1 X164.5 Y95 F540 E20 ; Move along arc, extrude 20 mm
;G1 X95 Y164.5 F540 E20 ; Next point on arc, extrude 20 mm
;G1 X0 Y190 F540 E20     ; Next point on arc, extrude 20 mm

; Prepare to start print
G1 E-5 F600          ; Retract slightly to relieve pressure
G1 Z1.5 F2500        ; Lower Z to start printing layer height""")
rotate = Rotate(Geometry=move_6.Geometry, Angle=degrees(Slider(45, range=0..100)), Plane=PlaneXY(0, 0, 0))  # -> Geometry, Transform
flatten_tree_4 = FlattenTree(Tree=vector_length_3, Path="{0}")
flatten_tree_5 = FlattenTree(Tree=vector_length_4, Path="{0}")
bounds_3 = Bounds(Numbers=flatten_tree_4)
bounds_4 = Bounds(Numbers=flatten_tree_5)
merge_4 = Merge(Data1=curve_6, Data2=scale_nu.Geometry, Data3=rotate.Geometry)
remap_numbers_3 = RemapNumbers(Value=flatten_tree_4, Source=bounds_3, Target="0.5 to 1")  # -> Mapped, Clipped
remap_numbers_4 = RemapNumbers(Value=flatten_tree_5, Source=bounds_4, Target="0.5 to 1")  # -> Mapped, Clipped
merge_5 = Merge(Data1=flatten(panel_14), Data2=flatten(concatenate_2), Data3=flatten(panel_13))
loft_2 = Loft(Curves=merge_4, Options={Adjust=False, Closed=False, LoftEnds=0, LoftSimp=0, LoftType=0, Rebuild=10, Refit=0.01})
panel_15 = Panel(remap_numbers_3.Mapped)
panel_16 = Panel(remap_numbers_4.Mapped)
cap_holes = CapHoles(Brep=loft_2)
contour_3 = Contour(Shape=loft_2, Point=Point(0, 0, 0), Direction=Vector(0, 0, 1), Distance=Slider(1.4, range=0.1..3))
panel_17 = Panel(merge_5)
control_points_5 = ControlPoints(Curve=contour_3)  # -> Points, Weights, Knots
cull_index_4 = CullIndex(List=control_points_5.Points, Indices="0", Wrap=True)
list_length_3 = ListLength(List=cull_index_4)
flip_matrix_7 = FlipMatrix(Data=cull_index_4)
polyline_15 = PolyLine(Vertices=flip_matrix_7, Closed=False)
explode_8 = Explode(Curve=polyline_15, Recursive=True)  # -> Segments, Vertices
end_points_6 = EndPoints(Curve=explode_8.Segments)  # -> Start, End
vector_2pt_5 = Vector2Pt(PointA=end_points_6.Start, PointB=end_points_6.End, Unitize=False)  # -> Vector, Length
range_6 = Range(Domain=Domain(0, 1), Steps=expr("x-1", list_length_3))
flip_matrix_8 = FlipMatrix(Data=vector_2pt_5.Vector)
multiplication_11 = Multiplication(A=flip_matrix_8, B=range_6)
move_8 = Move(Geometry=cull_index_4, Motion=multiplication_11)  # -> Geometry, Transform
polyline_16 = PolyLine(Vertices=flatten(move_8.Geometry), Closed=False)

# ---- group: Non-Planer
geometry_pipeline = GeometryPipeline(
    GroupByLayer=False,
    GroupByType=False,
    IncludeHidden=True,
    IncludeLocked=True,
    LayerFilter="Carl Vase",
    NameFilter="*",
    SublayerFiltering=True,
    TypeFilter=4)
geometry_pipeline_2 = GeometryPipeline(
    GroupByLayer=False,
    GroupByType=False,
    IncludeHidden=True,
    IncludeLocked=True,
    LayerFilter="Test Vase",
    NameFilter="*",
    SublayerFiltering=True,
    TypeFilter=4)
point_on_curve = PointOnCurve(geometry_pipeline_2, parameter=0.5)
deconstruct_3 = Deconstruct(Point=point_on_curve)  # -> XComponent, YComponent, ZComponent
sort_list = SortList(Keys=deconstruct_3.ZComponent, ValuesValuesA=point_on_curve)  # -> Keys, ValuesValuesA
sort_list_2 = SortList(Keys=deconstruct_3.ZComponent, ValuesValuesA=geometry_pipeline_2)  # -> Keys, ValuesValuesA
polyline_17 = PolyLine(Vertices=sort_list.ValuesValuesA, Closed=False)
seam = Seam(Curve=sort_list_2.ValuesValuesA, Seam=polyline_17)
loft_options = LoftOptions(Closed=False, Adjust=False, Rebuild=0, Refit=0, Type=0)
loft_3 = Loft(Curves=seam, Options=loft_options)
surface_3 = Surface()
brep_6 = Brep(<brep referenced from the Rhino model>)
geometry_3 = Geometry(brep_4)
deconstruct_brep_2 = DeconstructBrep(Brep=geometry_3)  # -> Faces, Edges, Vertices
surface_4 = Surface(deconstruct_brep_2.Faces)
bounding_box_3 = BoundingBox(Content=geometry_3, Plane=PlaneXY(0, 0, 0))  # -> Box, Box_2
deconstruct_box_3 = DeconstructBox(Box=bounding_box_3.Box)  # -> Plane, X, Y, Z
list_item_4 = ListItem(List=surface_4, Index=0, Wrap=True)
deconstruct_domain_3 = DeconstructDomain(Domain=deconstruct_box_3.Z)  # -> Start, End
division_6 = Division(A=deconstruct_domain_3.End, B=number_slider_3)
round_2 = Round(Number=division_6)  # -> Nearest, Floor, Ceiling
range_7 = Range(Domain=Domain(0, 1), Steps=round_2.Nearest)
panel_18 = Panel(round_2.Nearest)
brep_join_2 = BrepJoin(Breps=list_item_4)  # -> Breps, Closed
construct_point_3 = ConstructPoint(XCoordinate=range_7, YCoordinate=0, ZCoordinate=0)
iso_curve_3 = IsoCurve(Surface=reparameterize(geometry_3), UVPoint=construct_point_3)  # -> UIsocurve, VIsocurve
curve_7 = Curve(iso_curve_3.VIsocurve)
curve_8 = Curve(iso_curve_3.UIsocurve)
divide_curve_7 = DivideCurve(Curve=iso_curve_3.VIsocurve, Count=number_slider_5, Kinks=False)  # -> Points, Tangents, Parameters
polyline_18 = PolyLine(Vertices=divide_curve_7.Points, Closed=False)
control_points_6 = ControlPoints(Curve=polyline_18)  # -> Points, Weights, Knots
cull_index_5 = CullIndex(List=control_points_6.Points, Indices="0", Wrap=True)
list_length_4 = ListLength(List=cull_index_5)
flip_matrix_9 = FlipMatrix(Data=cull_index_5)
polyline_19 = PolyLine(Vertices=flip_matrix_9, Closed=False)
explode_9 = Explode(Curve=polyline_19, Recursive=True)  # -> Segments, Vertices
end_points_7 = EndPoints(Curve=explode_9.Segments)  # -> Start, End
vector_2pt_6 = Vector2Pt(PointA=end_points_7.Start, PointB=end_points_7.End, Unitize=False)  # -> Vector, Length
range_8 = Range(Domain=Domain(0, 1), Steps=expr("x-1", list_length_4))
flip_matrix_10 = FlipMatrix(Data=vector_2pt_6.Vector)
multiplication_12 = Multiplication(A=flip_matrix_10, B=range_8)
move_9 = Move(Geometry=cull_index_5, Motion=multiplication_12)  # -> Geometry, Transform
polyline_20 = PolyLine(Vertices=flatten(move_9.Geometry), Closed=False)
vector_length_5 = VectorLength(Vector=flip_matrix_10)
panel_19 = Panel(vector_length_5)
flatten_tree_6 = FlattenTree(Tree=vector_length_5, Path="{0}")
bounds_5 = Bounds(Numbers=flatten_tree_6)
remap_numbers_5 = RemapNumbers(Value=flatten_tree_6, Source=bounds_5, Target="0.5 to 1")  # -> Mapped, Clipped
panel_20 = Panel(remap_numbers_5.Mapped)

# ---- group: Gode Section
control_points_7 = ControlPoints(Curve=polyline_14)  # -> Points, Weights, Knots
explode_10 = Explode(Curve=polyline_14, Recursive=True)  # -> Segments, Vertices
polyline_21 = PolyLine(Vertices=flatten(control_points_7.Points), Closed=False)
panel_21 = Panel(control_points_7.Points)
length_3 = Length(Curve=explode_10.Segments)
deconstruct_4 = Deconstruct(Point=flatten(panel_21))  # -> XComponent, YComponent, ZComponent
multiplication_13 = Multiplication(A=Slider(30, range=0..100), B="60")
panel_22 = Panel("""; End G-code for WASP 40100 Clay Printer
G1 Z10 F1500         ; Raise Z to avoid scratching print (3x speed)
G1 E-5 F600          ; Retract filament slightly to relieve pressure (3x speed)

G1 X0 Y0 F3000       ; Move to home position at 3x speed
M107                 ; Turn off any fans or cooling (if applicable)

; Optional: disable motors
M84                  ; Disable motors""")
panel_23 = Panel("""; Start G-code for WASP 40100 Clay Printer with CFS
G21                  ; Set units to millimeters
G90                  ; Use absolute positioning for X, Y, and Z
M83                  ; Set extruder to relative mode
G92 X0 Y0 Z0 E0      ; Reset all axes positions to zero

; Homing axes
G28 X Y Z            ; Home all axes (only if your setup requires it)
G1 Z10 F1500         ; Raise Z to avoid scraping the print bed (3x speed)

; Prime extruder (initial small extrusion to get material flowing)
G1 E10 F600          ; Extrude 10 mm to prime at faster rate

; Move to starting position for priming arc along boundary of cylindrical build volume
G1 X190 Y0 Z0.5 F3000 ; Move to radius boundary on positive X axis at safe height (3x speed)

; Priming arc along 380 mm diameter boundary with point-to-point coordinates
G1 X164.5 Y95 F1800 E20 ; Move along arc, extrude 20 mm
G1 X95 Y164.5 F1800 E20 ; Next point on arc, extrude 20 mm
G1 X0 Y190 F1800 E20     ; Next point on arc, extrude 20 mm
G1 X-95 Y164.5 F1800 E20 ; Next point on arc, extrude 20 mm
G1 X-164.5 Y95 F1800 E20 ; Next point on arc, extrude 20 mm
G1 X-190 Y0 F1800 E20    ; Next point on arc, extrude 20 mm
G1 X-164.5 Y-95 F1800 E20 ; Next point on arc, extrude 20 mm
G1 X-95 Y-164.5 F1800 E20 ; Next point on arc, extrude 20 mm
G1 X0 Y-190 F1800 E20     ; Next point on arc, extrude 20 mm
G1 X95 Y-164.5 F1800 E20 ; Next point on arc, extrude 20 mm
G1 X164.5 Y-95 F1800 E20 ; Next point on arc, extrude 20 mm
G1 X190 Y0 F1800 E20      ; Complete the arc, extrude 20 mm

; Prepare to start print
G1 E-5 F600          ; Retract slightly to relieve pressure (3x speed)
G1 Z0.5 F1500        ; Lower Z to start printing layer height (3x speed)""")

# ----
division_7 = Division(A=length_3, B="3")

# ---- group: Gode Section (continued)
multiplication_14 = Multiplication(A=division_7, B=remap_numbers_4.Mapped)
insert_items_3 = InsertItems(List=multiplication_14, Item="0", Indices="0", Wrap=True)
concatenate_3 = Concatenate(
    F="G1",
    G=" F",
    E=multiplication_13,
    Fragment_A=" X",
    Fragment_B=deconstruct_4.XComponent,
    A=" Y",
    B=deconstruct_4.YComponent,
    C=" Z",
    D=deconstruct_4.ZComponent,
    H=" E",
    I=insert_items_3)
merge_6 = Merge(Data1=flatten(panel_23), Data2=flatten(concatenate_3), Data3=flatten(panel_22))
panel_24 = Panel(merge_6)

control_points_8 = ControlPoints(Curve=polyline_13)  # -> Points, Weights, Knots
explode_11 = Explode(Curve=polyline_13, Recursive=True)  # -> Segments, Vertices
polyline_22 = PolyLine(Vertices=flatten(control_points_8.Points), Closed=False)
panel_25 = Panel(control_points_8.Points)
length_4 = Length(Curve=explode_11.Segments)
deconstruct_5 = Deconstruct(Point=flatten(panel_25))  # -> XComponent, YComponent, ZComponent
multiplication_15 = Multiplication(A=Slider(32, range=0..100), B="60")
panel_26 = Panel("""; Start G-code for WASP 40100 Clay Printer with CFS
G21                  ; Set units to millimeters
G90                  ; Use absolute positioning for X, Y, and Z
M83                  ; Set extruder to relative mode
G92 X0 Y0 Z0 E0      ; Reset all axes positions to zero

; Homing axes
G28 X Y Z            ; Home all axes (only if your setup requires it)
G1 Z50 F5000; Raise Z to avoid scraping the print bed

; Prime extruder (initial small extrusion to get material flowing)
G1 E5 F600          ; Extrude 10 mm to prime at faster rate

; Move to starting position for priming arc along boundary of cylindrical build volume
;G1 X190 Y0 Z0.5 F9000 ; Move to radius boundary on positive X axis at safe height

; Priming arc along 380 mm diameter boundary with point-to-point coordinates
;G1 X164.5 Y95 F540 E20 ; Move along arc, extrude 20 mm
;G1 X95 Y164.5 F540 E20 ; Next point on arc, extrude 20 mm
;G1 X0 Y190 F540 E20     ; Next point on arc, extrude 20 mm

; Prepare to start print
G1 E-5 F600          ; Retract slightly to relieve pressure
G1 Z1.5 F2500        ; Lower Z to start printing layer height""")
panel_27 = Panel(""";End GCode
M104 S0  ;extruder heater off
M140 S0  ;heated bed heater off (if you have it)
G91  ;relative positioning
G1 E-1 F300   ;retract the filament a bit
G1 Z+1 E-5 F9000 ;move Z up a bit and retract filament even more
M107  ;fan off
G28 X0 Y0  ;move X/Y to min endstops, so the head is out of the way
;M84                         ;steppers off
G90                         ;absolute positioning""")

# ----
division_8 = Division(A=length_4, B=number_slider_6)

# ---- group: Gode Section (continued)
multiplication_16 = Multiplication(A=division_8, B=remap_numbers_3.Mapped)
insert_items_4 = InsertItems(List=multiplication_16, Item="0", Indices="0", Wrap=True)
concatenate_4 = Concatenate(
    F="G1",
    G=" F",
    E=multiplication_15,
    Fragment_A=" X",
    Fragment_B=deconstruct_5.XComponent,
    A=" Y",
    B=deconstruct_5.YComponent,
    C=" Z",
    D=deconstruct_5.ZComponent,
    H=" E",
    I=insert_items_4)
merge_7 = Merge(Data1=flatten(panel_26), Data2=flatten(concatenate_4), Data3=flatten(panel_27))
panel_28 = Panel(merge_7)

# ---- group: Non-Planer / Gode Section
control_points_9 = ControlPoints(Curve=polyline_20)  # -> Points, Weights, Knots
explode_12 = Explode(Curve=polyline_20, Recursive=True)  # -> Segments, Vertices
polyline_23 = PolyLine(Vertices=flatten(control_points_9.Points), Closed=False)
panel_29 = Panel(control_points_9.Points)
length_5 = Length(Curve=explode_12.Segments)
deconstruct_6 = Deconstruct(Point=flatten(panel_29))  # -> XComponent, YComponent, ZComponent
multiplication_17 = Multiplication(A=Slider(32, range=0..100), B="60")
panel_30 = Panel("""; Start G-code for WASP 40100 Clay Printer with CFS
G21                  ; Set units to millimeters
G90                  ; Use absolute positioning for X, Y, and Z
M83                  ; Set extruder to relative mode
G92 X0 Y0 Z0 E0      ; Reset all axes positions to zero

; Homing axes
G28 X Y Z            ; Home all axes (only if your setup requires it)
G1 Z50 F5000; Raise Z to avoid scraping the print bed

; Prime extruder (initial small extrusion to get material flowing)
G1 E5 F600          ; Extrude 10 mm to prime at faster rate

; Move to starting position for priming arc along boundary of cylindrical build volume
;G1 X190 Y0 Z0.5 F9000 ; Move to radius boundary on positive X axis at safe height

; Priming arc along 380 mm diameter boundary with point-to-point coordinates
;G1 X164.5 Y95 F540 E20 ; Move along arc, extrude 20 mm
;G1 X95 Y164.5 F540 E20 ; Next point on arc, extrude 20 mm
;G1 X0 Y190 F540 E20     ; Next point on arc, extrude 20 mm

; Prepare to start print
G1 E-5 F600          ; Retract slightly to relieve pressure
G1 Z1.5 F2500        ; Lower Z to start printing layer height""")
panel_31 = Panel(""";End GCode
M104 S0  ;extruder heater off
M140 S0  ;heated bed heater off (if you have it)
G91  ;relative positioning
G1 E-1 F300   ;retract the filament a bit
G1 Z+1 E-5 F9000 ;move Z up a bit and retract filament even more
M107  ;fan off
G28 X0 Y0  ;move X/Y to min endstops, so the head is out of the way
;M84                         ;steppers off
G90                         ;absolute positioning""")

# ---- group: Non-Planer (continued)
division_9 = Division(A=length_5, B=number_slider_8)

# ---- group: Non-Planer / Gode Section (continued)
multiplication_18 = Multiplication(A=division_9, B=remap_numbers_5.Mapped)
insert_items_5 = InsertItems(List=multiplication_18, Item="0", Indices="0", Wrap=True)
concatenate_5 = Concatenate(
    F="G1",
    G=" F",
    E=multiplication_17,
    Fragment_A=" X",
    Fragment_B=deconstruct_6.XComponent,
    A=" Y",
    B=deconstruct_6.YComponent,
    C=" Z",
    D=deconstruct_6.ZComponent,
    H=" E",
    I=insert_items_5)
merge_8 = Merge(Data1=flatten(panel_30), Data2=flatten(concatenate_5), Data3=flatten(panel_31))
panel_32 = Panel(merge_8)
