# Grasshopper definition Loft From Curves.gh (Grasshopper 1.0.7)
# plug-ins: LunchBox, Pufferfish

geometry_pipeline = GeometryPipeline(
    GroupByLayer=False,
    GroupByType=False,
    IncludeHidden=True,
    IncludeLocked=True,
    LayerFilter="Curves",
    NameFilter="*",
    SublayerFiltering=True,
    TypeFilter=4)
point_on_curve = PointOnCurve(geometry_pipeline, parameter=0.5)
deconstruct = Deconstruct(Point=point_on_curve)  # -> XComponent, YComponent, ZComponent
maximum = Maximum(A=deconstruct.ZComponent, B=deconstruct.ZComponent)
sort_list = SortList(Keys=maximum, ValuesValuesA=geometry_pipeline)  # -> Keys, ValuesValuesA
panel = Panel("""0 = Normal
1 = Loose
2 = Tight
3 = Stright
5 = Uniform""")
loft_options = LoftOptions(Closed=Toggle(False), Adjust=False, Rebuild=Slider(0, range=0..100), Refit=0, Type=Slider(0, range=0..5))
loft = Loft(Curves=sort_list.ValuesValuesA, Options=loft_options)
boolean_toggle = BooleanToggle(False)
invert_boolean = InvertBoolean(Boolean=boolean_toggle)  # -> Inverted, Number
ghpython_script = GhPythonScript(x=boolean_toggle, L="GH_Loft")  # -> out, a
# ---------- ghpython_script: Python ----------
__author__ = "CarlMcAteer"
__version__ = "2026.04.27"

import rhinoscriptsyntax as rs
import scriptcontext as sc
import Rhino

sc.doc = Rhino.RhinoDoc.ActiveDoc

if x:
    objs = rs.ObjectsByLayer(L, select=True)
    if objs:
        rs.DeleteObjects(objs)
# ---------- end ghpython_script ----------
object_bake = ObjectBake(
    BakeToggle=invert_boolean.Inverted,
    GeometryObjects=loft,
    Layer="GH_Loft",
    ObjectName="GH_Obj",
    ObjectColor="235, 108, 146",
    LayerColor="235, 108, 146")
