# Grasshopper definition Non Planer Gcode Engine - Wasp.gh (Grasshopper 1.0.7)
# plug-ins: Heteroptera

# Fliped matrix curve for extrusion
explode = Explode(Recursive=True)  # -> Segments, Vertices
# Main Curve
curve = Curve()
flip_matrix = FlipMatrix(Data=explode.Vertices)
vector_length = VectorLength(Vector=flip_matrix)
panel = Panel(vector_length)

# ---- group: Extrusion Multiple
number_slider = Slider(3, range=1..5)

# ----
control_points = ControlPoints(Curve=curve)  # -> Points, Weights, Knots
explode_2 = Explode(Curve=curve, Recursive=True)  # -> Segments, Vertices
flatten_tree = FlattenTree(Tree=vector_length, Path="{0}")
polyline = PolyLine(Vertices=flatten(control_points.Points), Closed=False)
length = Length(Curve=explode_2.Segments)
bounds = Bounds(Numbers=flatten_tree)
panel_2 = Panel(control_points.Points)
division = Division(A=length, B=number_slider)
remap_numbers = RemapNumbers(Value=flatten_tree, Source=bounds, Target="0.5 to 1")  # -> Mapped, Clipped
multiplication = Multiplication(A=division, B=remap_numbers.Mapped)
panel_3 = Panel(remap_numbers.Mapped)
deconstruct = Deconstruct(Point=flatten(panel_2))  # -> XComponent, YComponent, ZComponent
insert_items = InsertItems(List=multiplication, Item="0", Indices="0", Wrap=True)
multiplication_2 = Multiplication(A=Slider(32, range=0..100), B="60")
concatenate = Concatenate(
    F="G1",
    G=" F",
    E=multiplication_2,
    Fragment_A=" X",
    Fragment_B=deconstruct.XComponent,
    A=" Y",
    B=deconstruct.YComponent,
    C=" Z",
    D=deconstruct.ZComponent,
    H=" E",
    I=insert_items)
panel_4 = Panel("""; Start G-code for WASP 40100 Clay Printer with CFS
G21                  ; Set units to millimeters
G90                  ; Use absolute positioning for X, Y, and Z
M83                  ; Set extruder to relative mode
G92 X0 Y0 Z0 E0      ; Reset all axes positions to zero

; Homing axes
G28 X Y Z            ; Home all axes (only if your setup requires it)
G1 Z50 F5000; Raise Z to avoid scraping the print bed

; Prime extruder (initial small extrusion to get material flowing)
G1 E5 F600          ; Extrude 10 mm to prime at faster rate

; Move to starting position for priming arc along boundary of cylindrical build volume
;G1 X190 Y0 Z0.5 F9000 ; Move to radius boundary on positive X axis at safe height

; Priming arc along 380 mm diameter boundary with point-to-point coordinates
;G1 X164.5 Y95 F540 E20 ; Move along arc, extrude 20 mm
;G1 X95 Y164.5 F540 E20 ; Next point on arc, extrude 20 mm
;G1 X0 Y190 F540 E20     ; Next point on arc, extrude 20 mm

; Prepare to start print
G1 E-5 F600          ; Retract slightly to relieve pressure
G1 Z1.5 F2500        ; Lower Z to start printing layer height""")
panel_5 = Panel(""";End GCode
M104 S0  ;extruder heater off
M140 S0  ;heated bed heater off (if you have it)
G91  ;relative positioning
G1 E-1 F300   ;retract the filament a bit
G1 Z+1 E-5 F9000 ;move Z up a bit and retract filament even more
M107  ;fan off
G28 X0 Y0  ;move X/Y to min endstops, so the head is out of the way
;M84                         ;steppers off
G90                         ;absolute positioning""")
min_max = MinMax(Number=flatten(insert_items))  # -> Minimum, Maximum
panel_6 = Panel(min_max.Minimum)
panel_7 = Panel(min_max.Maximum)
merge = Merge(Data1=flatten(panel_4), Data2=flatten(concatenate), Data3=flatten(panel_5))
panel_8 = Panel(merge)
