# Grasshopper definition Non Planer Spiral from Loft.gh (Grasshopper 1.0.7)
# plug-ins: Heteroptera, Pufferfish, Bifocals, LunchBox, Kangaroo2 Components

# ---- group: Make Spiral from ISO Curve
number_slider = Slider(3.5, range=0.5..8)
geometry_pipeline = GeometryPipeline(
    GroupByLayer=False,
    GroupByType=False,
    IncludeHidden=True,
    IncludeLocked=True,
    LayerFilter="GH_Loft",
    NameFilter="*",
    SublayerFiltering=True,
    TypeFilter=1073741848)
bounding_box = BoundingBox(Content=geometry_pipeline, Plane=PlaneXY(0, 0, 0))  # -> Box, Box_2
deconstruct_box = DeconstructBox(Box=bounding_box.Box)  # -> Plane, X, Y, Z
# Make non planer set of curves from surface
deconstruct_domain = DeconstructDomain(Domain=deconstruct_box.Z)  # -> Start, End
division = Division(A=deconstruct_domain.End, B=number_slider)
panel = Panel(division)
range = Range(Domain=Domain(0, 1), Steps=panel)
construct_point = ConstructPoint(XCoordinate=range, YCoordinate=0, ZCoordinate=0)
panel_2 = Panel(construct_point)
iso_curve = IsoCurve(Surface=reparameterize(geometry_pipeline), UVPoint=panel_2)  # -> UIsocurve, VIsocurve

number_slider_2 = Slider(3.5, range=0.5..8)  # disabled
geometry_pipeline_2 = GeometryPipeline(
    GroupByLayer=False,
    GroupByType=False,
    IncludeHidden=True,
    IncludeLocked=True,
    LayerFilter="GH_Loft",
    NameFilter="*",
    SublayerFiltering=True,
    TypeFilter=1073741848)  # disabled
# Make non planer spiral from surface
bounding_box_2 = BoundingBox(Content=geometry_pipeline_2, Plane=PlaneXY(0, 0, 0))  # -> Box, Box_2; disabled
deconstruct_box_2 = DeconstructBox(Box=bounding_box_2.Box)  # -> Plane, X, Y, Z; disabled
deconstruct_domain_2 = DeconstructDomain(Domain=deconstruct_box_2.Z)  # -> Start, End; disabled
division_2 = Division(A=deconstruct_domain_2.End, B=number_slider_2)  # disabled
panel_3 = Panel(division_2)  # disabled
range_2 = Range(Domain=Domain(0, 1), Steps=panel_3)  # disabled
construct_point_2 = ConstructPoint(XCoordinate=range_2, YCoordinate=0, ZCoordinate=0)  # disabled
panel_4 = Panel(construct_point_2)  # disabled
iso_curve_2 = IsoCurve(Surface=reparameterize(geometry_pipeline_2), UVPoint=panel_4)  # -> UIsocurve, VIsocurve; disabled

# ----
geometry_pipeline_3 = GeometryPipeline(
    GroupByLayer=False,
    GroupByType=False,
    IncludeHidden=True,
    IncludeLocked=True,
    LayerFilter="GH_Loft",
    NameFilter="*",
    SublayerFiltering=True,
    TypeFilter=1073741848)  # disabled
number_slider_3 = Slider(3.5, range=0.5..8)  # disabled
bounding_box_3 = BoundingBox(Content=geometry_pipeline_3, Plane=PlaneXY(0, 0, 0))  # -> Box, Box_2; disabled
deconstruct_box_3 = DeconstructBox(Box=bounding_box_3.Box)  # -> Plane, X, Y, Z; disabled
number_slider_4 = Slider(40, range=0..100)  # disabled
deconstruct_domain_3 = DeconstructDomain(Domain=deconstruct_box_3.X)  # -> Start, End; disabled
deconstruct_domain_4 = DeconstructDomain(Domain=deconstruct_box_3.Y)  # -> Start, End; disabled
deconstruct_domain_5 = DeconstructDomain(Domain=deconstruct_box_3.Z)  # -> Start, End; disabled
reparameterize_surface = ReparameterizeSurface(Surface=geometry_pipeline_3)  # -> Reparameterized, Original; disabled
maximum = Maximum(A=deconstruct_domain_3.End, B=deconstruct_domain_4.End)  # disabled
division_3 = Division(A=number_slider_4, B=maximum)  # disabled
multiplication = Multiplication(A=division_3, B=deconstruct_domain_5.End)  # disabled
integer = Integer(multiplication)  # disabled
panel_5 = Panel("3")  # disabled
division_4 = Division(A=deconstruct_domain_5.End, B=number_slider_3)  # disabled
rebuild_surface = RebuildSurface(
    Surface=reparameterize_surface.Reparameterized,
    UDegree=panel_5,
    VDegree=panel_5,
    UNumber=number_slider_4,
    VNumber=integer)  # disabled
panel_6 = Panel(integer)  # disabled
panel_7 = Panel(division_4)  # disabled
panel_8 = Panel("0")  # disabled
panel_9 = Panel("1")  # disabled
panel_10 = Panel("0.0")  # disabled
panel_11 = Panel("1.0")  # disabled
construct_domain = ConstructDomain(DomainStart=panel_8, DomainEnd=panel_9)  # disabled
number_slider_5 = Slider(5065, range=0..10000)  # disabled
number_slider_6 = Slider(1028, range=0..2000)  # disabled
construct_domain_2 = ConstructDomain(DomainStart=panel_10, DomainEnd=panel_11)  # disabled
number_slider_7 = Slider(377, range=0..1000)  # disabled
range_3 = Range(Domain=construct_domain, Steps=number_slider_5)  # disabled
range_4 = Range(Domain=construct_domain_2, Steps=number_slider_6)  # disabled
graph_mapper = GraphMapper(
    range_4,
    x0=0,
    x1=1,
    y0=0,
    y1=1,
    container_name="Bezier",
    cpx=[0, 0.3072611392, 0.7040323615, 1],
    cpy=[0, 0.4089346528, 0.93047297, 1])  # disabled
expression = Expression(x=range_3, y=number_slider_7, Expression="x*y%1.0 ")  # disabled
range_5 = Range(Domain=Domain(0, 1), Steps=panel_7)  # disabled
panel_12 = Panel("-1")  # disabled
construct_point_3 = ConstructPoint(XCoordinate=range_5, YCoordinate=0, ZCoordinate=0)  # disabled
cull_index = CullIndex(List=expression, Indices=panel_12, Wrap=True)  # disabled
construct_point_4 = ConstructPoint(XCoordinate=graph_mapper, YCoordinate=cull_index, ZCoordinate=0)  # disabled

# ---- group: Flip Curve Matrix into vertical Lines
curve = Curve(iso_curve.VIsocurve)
flatten_tree = FlattenTree(Tree=curve, Path="{0}")
curve_to_polyline = CurveToPolyline(Curve=flatten_tree, ToleranceDistance=Slider(0.1, range=0..1), ToleranceAngle=0)  # -> Polyline, Segments
length = Length(Curve=curve_to_polyline.Polyline)
# Make vertical curves
min_max = MinMax(Number=flatten(length))  # -> Minimum, Maximum
division_5 = Division(A=min_max.Maximum, B=number_slider)
integer_2 = Integer(division_5)
x_plus_one = XPlusOne(NumberX=integer_2)
divide_curve = DivideCurve(Curve=curve_to_polyline.Polyline, Count=x_plus_one, Kinks=False)  # -> Points, Tangents, Parameters
flip_matrix = FlipMatrix(Data=divide_curve.Points)
deconstruct = Deconstruct(Point=flip_matrix)  # -> XComponent, YComponent, ZComponent
sort_list = SortList(Keys=deconstruct.ZComponent, ValuesValuesA=flip_matrix)  # -> Keys, ValuesValuesA
polyline = PolyLine(Vertices=sort_list.ValuesValuesA, Closed=False)

# ----
panel_13 = Panel(construct_point_3)  # disabled
evaluate_surface = EvaluateSurface(Surface=reparameterize(rebuild_surface), Point=construct_point_4)  # -> Point, Normal, UDirection, VDirection, Frame; disabled
iso_curve_3 = IsoCurve(Surface=reparameterize(rebuild_surface), UVPoint=panel_13)  # -> UIsocurve, VIsocurve; disabled
interpolate = Interpolate(Vertices=evaluate_surface.Point, Degree=3, Periodic=False, KnotStyle=1)  # -> Curve, Length, Domain; disabled
smooth = Smooth(Strength=1)  # disabled

# ---- group: Rebuild Curve from vertical lines and make its less extrem
# Rebuild new, more mellow set of curves
curve_2 = Curve(polyline)
curve_3 = Curve(polyline)
min_max_2 = MinMax(Number=flatten(curve_3))  # -> Minimum, Maximum
division_6 = Division(A=min_max_2.Maximum, B=number_slider)
integer_3 = Integer(division_6)
x_plus_one_2 = XPlusOne(NumberX=integer_3)
divide_curve_2 = DivideCurve(Curve=curve_2, Count=x_plus_one_2, Kinks=False)  # -> Points, Tangents, Parameters
flip_matrix_2 = FlipMatrix(Data=divide_curve_2.Points)
polyline_2 = PolyLine(Vertices=flip_matrix_2, Closed=False)

# ----
flatten_tree_2 = FlattenTree(Tree=polyline_2, Path="{0}")
surface = Surface(geometry_pipeline)
divide_curve_3 = DivideCurve(Curve=flatten_tree_2, Count=Slider(51, range=0..100), Kinks=False)  # -> Points, Tangents, Parameters
dispatch = Dispatch(List=divide_curve_3.Points, DispatchPattern=[True, False])  # -> ListA, ListB
# Add Waves to each Curve
brep_closest_point = BrepClosestPoint(Point=dispatch.ListB, Brep=surface)  # -> Point, Normal, Distance
# Remove z componant
# from vector (Cool)
deconstruct_vector = DeconstructVector(Vector=brep_closest_point.Normal)  # -> XComponent, YComponent, ZComponent
vector_xyz = VectorXYZ(XComponent=deconstruct_vector.XComponent, YComponent=deconstruct_vector.YComponent, ZComponent="0")  # -> Vector, Length
amplitude = Amplitude(Vector=vector_xyz.Vector, Amplitude=Slider(5, range=0..10))
move = Move(Geometry=dispatch.ListB, Motion=amplitude)  # -> Geometry, Transform
weave = Weave(Pattern=[0, 1], Stream0=dispatch.ListA, Stream1=move.Geometry, NullGaps=False)
polyline_3 = PolyLine(Vertices=weave, Closed=Toggle(True))

# ----
# Layer Point
# Resoultion
line_resolution = Slider(50, range=0..100)
curve_4 = Curve(polyline_3)
divide_curve_4 = DivideCurve(Curve=curve_4, Count=line_resolution, Kinks=False)  # -> Points, Tangents, Parameters
flip_matrix_3 = FlipMatrix(Data=divide_curve_4.Points)
# Turn curves into one spiral
polyline_4 = PolyLine(Vertices=flip_matrix_3, Closed=False)
explode = Explode(Curve=polyline_4, Recursive=True)  # -> Segments, Vertices
end_points = EndPoints(Curve=explode.Segments)  # -> Start, End
range_6 = Range(Domain=Domain(0, 1), Steps=expr("x-1", line_resolution))
vector_2pt = Vector2Pt(PointA=end_points.Start, PointB=end_points.End, Unitize=False)  # -> Vector, Length
flip_matrix_4 = FlipMatrix(Data=vector_2pt.Vector)
multiplication_2 = Multiplication(A=flip_matrix_4, B=range_6)
move_2 = Move(Geometry=divide_curve_4.Points, Motion=multiplication_2)  # -> Geometry, Transform
flatten_tree_3 = FlattenTree(Tree=move_2.Geometry, Path="{0}")
polyline_5 = PolyLine(Vertices=flatten_tree_3, Closed=False)
